vi "Pattern-Coverters-IQ-Game.gvi"   [LabVIEW NXG 5.0.0]
panel controls:
  "Cluster_1": T1
  "Cluster_2": T1
  "Cluster_3": T1
  "Cluster_4": T1
  "Cluster_5": T1
  "Cluster_6": T1
  "Cluster_7": T1
  "Cluster_8": T1
  "Converter_UP1_Activation": bool
  "Converter_UP_1": string
  "Converter_UP_2": string
  "Converter_UP2_Activation": bool
  "stop": bool
  "Converter_UP_3": string
  "Converter_UP3_Activation": bool
panel indicators:
  "E_1": i32
  "E_2": i32
  "E_3": i32
  "E_4": i32
types:
  T1 = cluster{"L_1": bool, "L_2": bool, "L_3": bool, "L_4": bool}
diagram:
  while {
    Cluster To Array(cluster=$Cluster_4) -> (array=w1)
    Boolean Array To Number(Boolean array=w1) -> (number=w2)
    case (w2) {
      frame 0, Default {
        Build Cluster(FALSE, FALSE, FALSE, FALSE) -> w3
        $Cluster_4 <- w3
      }
      frame 1 {
        Build Cluster(TRUE, FALSE, FALSE, FALSE) -> w4
        $Cluster_4 <- w4
      }
      frame 2 {
        Build Cluster(FALSE, TRUE, FALSE, FALSE) -> w5
        $Cluster_4 <- w5
      }
      frame 4 {
        Build Cluster(FALSE, FALSE, TRUE, FALSE) -> w6
        $Cluster_4 <- w6
      }
      frame 8 {
        Build Cluster(FALSE, FALSE, FALSE, TRUE) -> w7
        $Cluster_4 <- w7
      }
    }
    Cluster To Array(cluster=$Cluster_3) -> (array=w8)
    Boolean Array To Number(Boolean array=w8) -> (number=w9)
    case (w9) {
      frame 0, Default {
        Build Cluster(FALSE, FALSE, FALSE, FALSE) -> w10
        $Cluster_3 <- w10
      }
      frame 1 {
        Build Cluster(TRUE, FALSE, FALSE, FALSE) -> w11
        $Cluster_3 <- w11
      }
      frame 2 {
        Build Cluster(FALSE, TRUE, FALSE, FALSE) -> w12
        $Cluster_3 <- w12
      }
      frame 4 {
        Build Cluster(FALSE, FALSE, TRUE, FALSE) -> w13
        $Cluster_3 <- w13
      }
      frame 8 {
        Build Cluster(FALSE, FALSE, FALSE, TRUE) -> w14
        $Cluster_3 <- w14
      }
    }
    Cluster To Array(cluster=$Cluster_2) -> (array=w15)
    Boolean Array To Number(Boolean array=w15) -> (number=w16)
    case (w16) {
      frame 0, Default {
        Build Cluster(FALSE, FALSE, FALSE, FALSE) -> w17
        $Cluster_2 <- w17
      }
      frame 1 {
        Build Cluster(TRUE, FALSE, FALSE, FALSE) -> w18
        $Cluster_2 <- w18
      }
      frame 2 {
        Build Cluster(FALSE, TRUE, FALSE, FALSE) -> w19
        $Cluster_2 <- w19
      }
      frame 4 {
        Build Cluster(FALSE, FALSE, TRUE, FALSE) -> w20
        $Cluster_2 <- w20
      }
      frame 8 {
        Build Cluster(FALSE, FALSE, FALSE, TRUE) -> w21
        $Cluster_2 <- w21
      }
    }
    Cluster To Array(cluster=$Cluster_1) -> (array=w22)
    Boolean Array To Number(Boolean array=w22) -> (number=w23)
    case (w23) {
      frame 0, Default {
        Build Cluster(FALSE, FALSE, FALSE, FALSE) -> w24
        $Cluster_1 <- w24
      }
      frame 1 {
        Build Cluster(TRUE, FALSE, FALSE, FALSE) -> w25
        $Cluster_1 <- w25
      }
      frame 2 {
        Build Cluster(FALSE, TRUE, FALSE, FALSE) -> w26
        $Cluster_1 <- w26
      }
      frame 4 {
        Build Cluster(FALSE, FALSE, TRUE, FALSE) -> w27
        $Cluster_1 <- w27
      }
      frame 8 {
        Build Cluster(FALSE, FALSE, FALSE, TRUE) -> w28
        $Cluster_1 <- w28
      }
    }
    Cluster To Array(cluster=$Cluster_5) -> (array=w29)
    Boolean Array To Number(Boolean array=w29) -> (number=w30)
    case (w30) {
      frame 0, Default {
        Build Cluster(FALSE, FALSE, FALSE, FALSE) -> w31
        $Cluster_5 <- w31
      }
      frame 1 {
        Build Cluster(TRUE, FALSE, FALSE, FALSE) -> w32
        $Cluster_5 <- w32
      }
      frame 2 {
        Build Cluster(FALSE, TRUE, FALSE, FALSE) -> w33
        $Cluster_5 <- w33
      }
      frame 4 {
        Build Cluster(FALSE, FALSE, TRUE, FALSE) -> w34
        $Cluster_5 <- w34
      }
      frame 8 {
        Build Cluster(FALSE, FALSE, FALSE, TRUE) -> w35
        $Cluster_5 <- w35
      }
    }
    Cluster To Array(cluster=$Cluster_6) -> (array=w36)
    Boolean Array To Number(Boolean array=w36) -> (number=w37)
    case (w37) {
      frame 0, Default {
        Build Cluster(FALSE, FALSE, FALSE, FALSE) -> w38
        $Cluster_6 <- w38
      }
      frame 1 {
        Build Cluster(TRUE, FALSE, FALSE, FALSE) -> w39
        $Cluster_6 <- w39
      }
      frame 2 {
        Build Cluster(FALSE, TRUE, FALSE, FALSE) -> w40
        $Cluster_6 <- w40
      }
      frame 4 {
        Build Cluster(FALSE, FALSE, TRUE, FALSE) -> w41
        $Cluster_6 <- w41
      }
      frame 8 {
        Build Cluster(FALSE, FALSE, FALSE, TRUE) -> w42
        $Cluster_6 <- w42
      }
    }
    Cluster To Array(cluster=$Cluster_7) -> (array=w43)
    Boolean Array To Number(Boolean array=w43) -> (number=w44)
    case (w44) {
      frame 0, Default {
        Build Cluster(FALSE, FALSE, FALSE, FALSE) -> w45
        $Cluster_7 <- w45
      }
      frame 1 {
        Build Cluster(TRUE, FALSE, FALSE, FALSE) -> w46
        $Cluster_7 <- w46
      }
      frame 2 {
        Build Cluster(FALSE, TRUE, FALSE, FALSE) -> w47
        $Cluster_7 <- w47
      }
      frame 4 {
        Build Cluster(FALSE, FALSE, TRUE, FALSE) -> w48
        $Cluster_7 <- w48
      }
      frame 8 {
        Build Cluster(FALSE, FALSE, FALSE, TRUE) -> w49
        $Cluster_7 <- w49
      }
    }
    Cluster To Array(cluster=$Cluster_8) -> (array=w50)
    Boolean Array To Number(Boolean array=w50) -> (number=w51)
    case (w51) {
      frame 0, Default {
        Build Cluster(FALSE, FALSE, FALSE, FALSE) -> w52
        $Cluster_8 <- w52
      }
      frame 1 {
        Build Cluster(TRUE, FALSE, FALSE, FALSE) -> w53
        $Cluster_8 <- w53
      }
      frame 2 {
        Build Cluster(FALSE, TRUE, FALSE, FALSE) -> w54
        $Cluster_8 <- w54
      }
      frame 4 {
        Build Cluster(FALSE, FALSE, TRUE, FALSE) -> w55
        $Cluster_8 <- w55
      }
      frame 8 {
        Build Cluster(FALSE, FALSE, FALSE, TRUE) -> w56
        $Cluster_8 <- w56
      }
    }
    for (N = 4) (iteration -> i1) {
      Cluster To Array(cluster=$Cluster_5) -> (array=w58)
      Boolean Array To Number(Boolean array=w58) -> (number=w59)
      Cluster To Array(cluster=$Cluster_6) -> (array=w60)
      Boolean Array To Number(Boolean array=w60) -> (number=w61)
      Cluster To Array(cluster=$Cluster_7) -> (array=w62)
      Boolean Array To Number(Boolean array=w62) -> (number=w63)
      Cluster To Array(cluster=$Cluster_8) -> (array=w64)
      Boolean Array To Number(Boolean array=w64) -> (number=w65)
      Build Array(w59, w61, w63, w65) -> w66
      Array Index(array=w66) -> (out0[i1]=w67)
      String Subset(length (rest)=1, offset (0)=0, string=$Converter_UP_3) -> w68
      Floating Point String To Number(string=w68) -> (number=w69)
      Round To Nearest(number=w69) -> w70
      Decrement(x=w70) -> w71
      String Subset(length (rest)=1, offset (0)=1, string=$Converter_UP_3) -> w72
      Floating Point String To Number(string=w72) -> (number=w73)
      Round To Nearest(number=w73) -> w74
      Decrement(x=w74) -> w75
      String Subset(length (rest)=1, offset (0)=2, string=$Converter_UP_3) -> w76
      Floating Point String To Number(string=w76) -> (number=w77)
      Round To Nearest(number=w77) -> w78
      Decrement(x=w78) -> w79
      String Subset(length (rest)=1, offset (0)=3, string=$Converter_UP_3) -> w80
      Floating Point String To Number(string=w80) -> (number=w81)
      Round To Nearest(number=w81) -> w82
      Decrement(x=w82) -> w83
      String Subset(length (rest)=1, offset (0)=0, string=$Converter_UP_2) -> w84
      Floating Point String To Number(string=w84) -> (number=w85)
      Round To Nearest(number=w85) -> w86
      Decrement(x=w86) -> w87
      String Subset(length (rest)=1, offset (0)=1, string=$Converter_UP_2) -> w88
      Floating Point String To Number(string=w88) -> (number=w89)
      Round To Nearest(number=w89) -> w90
      Decrement(x=w90) -> w91
      String Subset(length (rest)=1, offset (0)=2, string=$Converter_UP_2) -> w92
      Floating Point String To Number(string=w92) -> (number=w93)
      Round To Nearest(number=w93) -> w94
      Decrement(x=w94) -> w95
      String Subset(length (rest)=1, offset (0)=3, string=$Converter_UP_2) -> w96
      Floating Point String To Number(string=w96) -> (number=w97)
      Round To Nearest(number=w97) -> w98
      Decrement(x=w98) -> w99
      Cluster To Array(cluster=$Cluster_1) -> (array=w100)
      Boolean Array To Number(Boolean array=w100) -> (number=w101)
      Cluster To Array(cluster=$Cluster_2) -> (array=w102)
      Boolean Array To Number(Boolean array=w102) -> (number=w103)
      Cluster To Array(cluster=$Cluster_3) -> (array=w104)
      Boolean Array To Number(Boolean array=w104) -> (number=w105)
      Cluster To Array(cluster=$Cluster_4) -> (array=w106)
      Boolean Array To Number(Boolean array=w106) -> (number=w107)
      Build Array(w101, w103, w105, w107) -> w108
      String Subset(length (rest)=1, offset (0)=0, string=$Converter_UP_1) -> w109
      Floating Point String To Number(string=w109) -> (number=w110)
      Round To Nearest(number=w110) -> w111
      Decrement(x=w111) -> w112
      String Subset(length (rest)=1, offset (0)=1, string=$Converter_UP_1) -> w113
      Floating Point String To Number(string=w113) -> (number=w114)
      Round To Nearest(number=w114) -> w115
      Decrement(x=w115) -> w116
      String Subset(length (rest)=1, offset (0)=2, string=$Converter_UP_1) -> w117
      Floating Point String To Number(string=w117) -> (number=w118)
      Round To Nearest(number=w118) -> w119
      Decrement(x=w119) -> w120
      String Subset(length (rest)=1, offset (0)=3, string=$Converter_UP_1) -> w121
      Floating Point String To Number(string=w121) -> (number=w122)
      Round To Nearest(number=w122) -> w123
      Decrement(x=w123) -> w124
      Array Index(array=w108) -> (out0[w112]=w125, out1[w116]=w126, out2[w120]=w127, out3[w124]=w128)
      Build Array(w125, w126, w127, w128) -> w129
      Array Index(array=w129) -> (out0[w87]=w130, out1[w91]=w131, out2[w95]=w132, out3[w99]=w133)
      Build Array(w130, w131, w132, w133) -> w134
      Array Index(array=w134) -> (out0[w71]=w135, out1[w75]=w136, out2[w79]=w137, out3[w83]=w138)
      Build Array(w135, w136, w137, w138) -> w139
      Select(s=$Converter_UP1_Activation, t=w129, f=w108) -> w140
      Select(s=$Converter_UP2_Activation, t=w134, f=w140) -> w141
      Select(s=$Converter_UP3_Activation, t=w139, f=w141) -> w142
      Search 1D Array(1D array=w142, element=w67, start index (0)=0) -> (index of element=w143)
      append w143 to w57
    }
    Array Index(array=w57) -> (out0[0]=w144, out1[1]=w145, out2[2]=w146, out3[3]=w147)
    Increment(x=w144) -> w148
    $E_1 <- w148
    Increment(x=w145) -> w149
    $E_2 <- w149
    Increment(x=w146) -> w150
    $E_3 <- w150
    Increment(x=w147) -> w151
    $E_4 <- w151
    stop if $stop
  }
